# Grasshopper definition Eabbit_NV.gh (Grasshopper 1.0.7)
# plug-ins: Eabbit, Eabbit_NV

# ---- group: Wind data
# Harvard Graduate School of Design
# This .gh file is created by Ellie Jungmin Han.
# __author__ = "jhan2harvard"
# __version__ = "2022.3.22"
data = Data([360, 350, 360, 10, 10, 360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])

# ---- group: CwCalculation
# West
# East
# South
# North
number_slider = Slider(0.532, range=0..10)
number_slider_2 = Slider(5.25, range=0..10)
number_slider_3 = Slider(5.25, range=0..10)
avr = Average(Input=data)
number_slider_4 = Slider(5.25, range=0..10)
number_slider_5 = Slider(5.25, range=0..10)
panel = Panel("Façade orientation (S=180, N=0) [°]")
windpressurecoef = WindpressureCoef(
    DoubleWindDirection=avr,
    DoubleFacadeOrientation=Slider(180, range=0..360),
    DoubleVerticalLocationOfOpening=Slider(2.1, range=0..10),
    DoubleBuildingHeight=Slider(3.5, range=0..10),
    DoubleHorizontalLocationOfOpening=Slider(1.313, range=0..10),
    DoubleWidthOfFacade=number_slider_5,
    DoubleWidthOfAdjacentFacades=number_slider_5)  # -> StringLog, DoubleCw, DoubleCwAve
windpressurecoef_2 = WindpressureCoef(
    DoubleWindDirection=avr,
    DoubleFacadeOrientation=Slider(90, range=0..360),
    DoubleVerticalLocationOfOpening=Slider(2.1, range=0..10),
    DoubleBuildingHeight=Slider(3.5, range=0..10),
    DoubleHorizontalLocationOfOpening=Slider(1.313, range=0..10),
    DoubleWidthOfFacade=number_slider_4,
    DoubleWidthOfAdjacentFacades=number_slider_4)  # -> StringLog, DoubleCw, DoubleCwAve
windpressurecoef_3 = WindpressureCoef(
    DoubleWindDirection=avr,
    DoubleFacadeOrientation=Slider(270, range=0..360),
    DoubleVerticalLocationOfOpening=Slider(3.15, range=0..10),
    DoubleBuildingHeight=Slider(3.5, range=0..10),
    DoubleHorizontalLocationOfOpening=number_slider,
    DoubleWidthOfFacade=number_slider_2,
    DoubleWidthOfAdjacentFacades=number_slider_2)  # -> StringLog, DoubleCw, DoubleCwAve
windpressurecoef_4 = WindpressureCoef(
    DoubleWindDirection=avr,
    DoubleFacadeOrientation=Slider(0, range=0..360),
    DoubleVerticalLocationOfOpening=Slider(3.15, range=0..10),
    DoubleBuildingHeight=Slider(3.5, range=0..10),
    DoubleHorizontalLocationOfOpening=Slider(0.532, range=0..10),
    DoubleWidthOfFacade=number_slider_3,
    DoubleWidthOfAdjacentFacades=number_slider_3)  # -> StringLog, DoubleCw, DoubleCwAve
panel_2 = Panel(windpressurecoef_3.DoubleCwAve)
panel_3 = Panel(windpressurecoef_2.DoubleCwAve)
panel_4 = Panel(windpressurecoef.DoubleCwAve)
panel_5 = Panel(windpressurecoef_4.DoubleCwAve)

# ---- group: WindowConfiguration
brep = Brep(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)
srf = Surface(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)
srf_2 = Surface(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)
windowfr = EWindowFrame(
    SurfaceForWindow=srf,
    IntForType=Slider(10, range=0..10),
    Width=Slider(0.8, range=0..1),
    Height=Slider(1.5, range=0..10),
    BoolForFlip=False)  # -> Window, NormalVectors
windowfr_2 = EWindowFrame(
    SurfaceForWindow=srf_2,
    IntForType=Slider(9, range=0..10),
    Width=Slider(0.8, range=0..1),
    Height=Slider(1.5, range=0..10),
    BoolForFlip=False)  # -> Window, NormalVectors
rec = Rectangle(windowfr.Window)
rec_2 = Rectangle(windowfr_2.Window)
number_slider_6 = Slider(0.007, range=0..0.01)
boundary = BoundarySurfaces(Edges=rec)
number_slider_7 = Slider(40, range=0..100)
number_slider_8 = Slider(0.001, range=0..0.01)
boundary_2 = BoundarySurfaces(Edges=rec_2)
number_slider_9 = Slider(20, range=0..100)
list = ValueList({"Sliding": 0, "Single Hung": 1, "Double Hung": 2, "Casement": 3, "Awning": 4, "Central pivot window": 5}, selected="Sliding")
list_2 = ValueList({"Sliding": 0, "Single Hung": 1, "Double Hung": 2, "Casement": 3, "Awning": 4, "Central pivot window": 5}, selected="Central pivot window")
toggle = BooleanToggle(True)
toggle_2 = BooleanToggle(True)
brep_2 = Brep(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)

# ----
windows = EWindow(
    SurfaceForWindow=boundary,
    IntForType=list,
    DoubleForSliding=number_slider_7,
    DoubleForGlazingGap=number_slider_6,
    DoubleForMaximumDepth=toggle,
    BoolForFlip=Toggle(False))  # -> Window, OpeningArea, OpeningArea_2
windows_2 = EWindow(
    SurfaceForWindow=boundary_2,
    IntForType=list_2,
    DoubleForSliding=number_slider_9,
    DoubleForGlazingGap=number_slider_8,
    DoubleForMaximumDepth=toggle_2,
    BoolForFlip=Toggle(True))  # -> Window, OpeningArea, OpeningArea_2
building_geo = Brep([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])

floor = Surface(<surface referenced from the Rhino model>)
area = Area(Geometry=floor)  # -> Area, Centroid
data_2 = Data(area.Area)
internalheatgain = InternalQ(DoubleFloorArea=data_2, DoubleHeatGainPerM2="35", IntOfPeople=Slider(2, range=0..10))

# ---- group: CrossVentilation
brep_3 = Brep(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)
awning = Slider(0.55, range=0..1)
number_slider_10 = Slider(1.69, range=0..10)
number_slider_11 = Slider(3.5, range=0..10)
brep_4 = Brep(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)

# ----
multiplication = Multiplication(A=area.Area, B=number_slider_11)

# ---- group: CrossVentilation / Meter
areacdeff_north = PythonScript(areaA=windows.OpeningArea, areaB=windows_2.OpeningArea, DisCoef=awning)  # -> out, AreaCdeff; inputs areaA: list, areaB: list
# ---------- areacdeff_north: Python ----------
import math 

print areaA
def inchesToMeterSQ(Lst):
    myLst = []
    for i in range(0,len(Lst)):
        myLst.append(float(Lst[i])*0.00064516)
    return myLst
    
#areaA = inchesToMeterSQ(areaA)
#areaB = inchesToMeterSQ(areaB)

def totalAreaCoeff(Areas,Cdeff):
	reversedAcdLst = []
	sumLst = 0

	for i in range (0,len(Areas)):
		Acd = Areas[i] * Cdeff [i]
		powerAcd = Acd**2
		reversedAcd = 1 / powerAcd
		# print "reversed",reversedAcd
		reversedAcdLst.append(reversedAcd) 
		# print reversedAcdLst
		sumLst += reversedAcd 
		# print math.sqrt(sumLst)
	
	return 1 / math.sqrt(sumLst)

#print type(area[0])

def areaSum(area):
    sumSoFar = 0
    for i in range(0,len(area)):
        sumSoFar += float(area[i])
    return sumSoFar

A = areaSum(areaA)
B = areaSum(areaB)

def makeLst(A,B):
    Lst = []
    Lst.append(A)
    Lst.append(B)
    return Lst
    
Areas = makeLst(A,B)

def stringToFloat(area):
    tempLst = []
    for i in range (0,len(area)):
        tempLst.append(float(area[i]))
    return tempLst

myCoef = float(DisCoef)

def coefLst(coef,Areas):
    coefLst = []
    for i in range(0,len(Areas)):
        coefLst.append(float(coef))
    return coefLst
    
    
    
ListCoef = coefLst(myCoef,Areas)
#Areas = stringToFloat(area)
#print type(ListCoef[0])
AreaCdeff = totalAreaCoeff(Areas,ListCoef)
# ---------- end areacdeff_north ----------

# ----
northcw = Data(-0.3660083864)
southcw = Data(0.5050906077)
data_3 = Data(internalheatgain)
data_4 = Data(area.Area)
nvcrossventilation = NVCrossVentilation(
    DoubleAcdEff=areacdeff_north.AreaCdeff,
    DoubleWindVelocity=number_slider_10,
    DoubleCwIn=southcw,
    DoubleCwOut=northcw,
    DoubleHeatGain=internalheatgain,
    DoubleFloorArea=data_4,
    DoubleRoomHeight=number_slider_11)  # -> DoubleFlowRate, DoubleDeltaT, DoubleACH

# ---- group: Visualization
gradient = Gradient(
    LowerLimit=0,
    UpperLimit=15,
    Parameter=nvcrossventilation.DoubleACH,
    stops=[0: RGB(172, 102, 3), 0: RGB(209, 238, 201), 0: RGB(234, 38, 0), 0.25: RGB(234, 126, 0), 0.5: RGB(254, 244, 84), 0.75: RGB(173, 203, 249), 1: RGB(75, 107, 169)])
building_geo_2 = Brep([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])
preview = CustomPreview(Geometry=floor, Shader=gradient)
